# Grasshopper definition serpentine wire.gh (Grasshopper 1.0.7)

number_slider = Slider(11, range=0..100)
crv = Curve([<curve referenced from the Rhino model> x2])
len = Length(Curve=crv)
divdist = DivideDistance(Curve=crv, Distance=number_slider)  # -> Points, Tangents, Parameters
Z = UnitZ(Factor=1)
mod = Modulus(A=len, B=number_slider)
number_slider_2 = Slider(6, range=0..10)
xprod = CrossProduct(VectorA=divdist.Tangents, VectorB=Z, Unitize=False)  # -> Vector, Length
unit = UnitVector(Vector=xprod.Vector)
amp = Amplitude(Vector=unit, Amplitude=number_slider_2)
neg = Negative(Value=number_slider_2)
amp_2 = Amplitude(Vector=unit, Amplitude=neg)
amp_3 = Amplitude(Vector=xprod.Vector, Amplitude=Slider(-1, range=-2..1))
move = Move(Geometry=divdist.Points, Motion=amp)  # -> Geometry, Transform
move_2 = Move(Geometry=divdist.Points, Motion=amp_2)  # -> Geometry, Transform
line = LineSDL(Start=divdist.Points, Direction=amp_3, Length=number_slider_2)
line_2 = LineSDL(Start=divdist.Points, Direction=xprod.Vector, Length=number_slider_2)
number_slider_3 = Slider(0, range=0..1)
cull_i = CullIndex(List=line, Indices=number_slider_3, Wrap=True)
cull_i_2 = CullIndex(List=move_2.Geometry, Indices=number_slider_3, Wrap=True)
amp_4 = Amplitude(Vector=cull_i, Amplitude=Slider(-1, range=-2..1))
dispatch = Dispatch(List=move.Geometry, DispatchPattern=[True, False])  # -> ListA, ListB
dispatch_2 = Dispatch(List=line_2, DispatchPattern=[True, False])  # -> ListA, ListB
dispatch_3 = Dispatch(List=amp_4, DispatchPattern=[True, False])  # -> ListA, ListB
dispatch_4 = Dispatch(List=cull_i_2, DispatchPattern=[True, False])  # -> ListA, ListB
short = ShortestList(ListA=dispatch.ListA, ListB=dispatch.ListB, TrimMode=2)  # -> ListA, ListB
short_2 = ShortestList(ListA=dispatch_2.ListA, ListB=dispatch_2.ListB, TrimMode=2)  # -> ListA, ListB
short_3 = ShortestList(ListA=dispatch_3.ListA, ListB=dispatch_3.ListB, TrimMode=2)  # -> ListA, ListB
short_4 = ShortestList(ListA=dispatch_4.ListA, ListB=dispatch_4.ListB, TrimMode=2)  # -> ListA, ListB
biarc = BiArc(
    StartPoint=short_4.ListA,
    StartTangent=short_3.ListA,
    EndPoint=short_4.ListB,
    EndTangent=short_3.ListB,
    Ratio=Slider(-2, range=-2..1))  # -> FirstArc, SecondArc, BiArc
biarc_2 = BiArc(
    StartPoint=short.ListA,
    StartTangent=short_2.ListA,
    EndPoint=short.ListB,
    EndTangent=short_2.ListB,
    Ratio=Slider(1, range=-2..1))  # -> FirstArc, SecondArc, BiArc
number_slider_4 = Slider(2.5, range=0..10)
join = JoinCurves(Curves=[biarc_2.FirstArc, biarc.FirstArc, line_2, line, biarc.SecondArc], Preserve=False)
neg_2 = Negative(Value=number_slider_4)
offset = OffsetCurve(Curve=join, Distance=number_slider_4, Plane=PlaneXY(0, 0, 0), Corners=1)
offset_2 = OffsetCurve(Curve=join, Distance=neg_2, Plane=PlaneXY(0, 0, 0), Corners=1)
