# Grasshopper definition voronoi.gh (Grasshopper 1.0.7)

random_seed = Slider(6, range=0..10)
numbers = Slider(41, range=0..100)
curve = Curve(<curve referenced from the Rhino model>)
populate_2d = Populate2D(Region=curve, Count=numbers, Seed=random_seed)
curve_2 = Curve(<curve referenced from the Rhino model>)
point_in_curves = PointInCurves(Point=populate_2d, Curves=curve_2)  # -> Relationship, Index, Point
division = Division(A=point_in_curves.Relationship, B="2")
cull_pattern = CullPattern(List=populate_2d, CullPattern=division)
voronoi = Voronoi(Points=cull_pattern, Boundary=curve, BruteForceOverride=False)
offset_distance = Slider(-3, range=-10..0)
region_intersection = RegionIntersection(CurvesA=voronoi, CurvesB=curve_2)
offset_curve = OffsetCurve(Curve=region_intersection, Distance=offset_distance, Plane=PlaneXY(0, 0, 0), Corners=1)
rebuild_curve = RebuildCurve(Curve=offset_curve, Degree=Slider(2, range=0..10), Count=Slider(6, range=0..10), Tangents=False)
